# Dynamo graph Заполнение BI_этаж по нижней границе.dyn (Dynamo 2.0.4.12684)

категории = Python()  # graph input
# ---------- категории.python (61 lines) ----------
OUT = ["Арматура воздуховодов",
	"Арматура трубопроводов",
	"Воздуховоды",
	"Воздухораспределители",
	"Гибкие воздуховоды",
	"Гибкие трубы",
	"Датчики",
	"Двери",
	"Импосты витража",
	"Кабельные лотки",
	"Каркас несущий",
	"Колонны",
	"Комплекты мебели",
	"Короба",
	"Крыши",
	"Лестницы",
	"Лестницы - Марши",
	"Лестницы - Площадки",
	"Лестницы - Опоры",
	"Материалы изоляции воздуховодов",
	"Материалы изоляции труб",
	"Мебель",
	"Наборы оборудования",
	"Несущая арматура",
	"Несущие колонны",
	"Обобщенные модели",
	"Оборудование",
	"Ограждение",
	"Ограждение - Верхние поручни",
	"Ограждение - Опоры",
	"Ограждение - Перила",
	"Окна",
	"Осветительные приборы",
	"Охранная сигнализация",
	"Пандус",
	"Панели витража",
	"Парковка",
	"Перекрытия",
	"Пожарная сигнализация",
	"Помещения",
	"Потолки",
	"Провода",
	"Сантехнические приборы",
	"Соединения несущих конструкций",
	"Соединители несущей арматуры",
	"Соединительные детали воздуховодов",
	"Соединительные детали кабельных лотков",
	"Соединительные детали коробов",
	"Соединительные детали трубопроводов",
	"Специальное оборудование",
	"Спринклеры",
	"Стены",
	"Стены - Выступающие профили",
	"Телефонные устройства",
	"Трубы",
	"Устройства вызова и оповещения",
	"Устройства связи",
	"Фундамент несущей конструкции",
	"Шкафы",
	"Электрические приборы",
	"Электрооборудование"]
# ----------------------------------------
byName = Category.ByName(name=категории)
all_elements_of_category = ElementsOfCategory(Category=byName)
flatten = List.Flatten(list=all_elements_of_category)
parameters = Element.Parameters(element=flatten)
name = Parameter.Name(parameter=parameters)
заполняемый_параметр = StringInput("BI_этаж")
# note: Фильтрация по наличию параметра этажа
contains = List.Contains(list=name@L2, item=заполняемый_параметр)
filterByBoolMask = List.FilterByBoolMask(list=flatten, mask=contains)
parameterByName = Parameter.ParameterByName(element=filterByBoolMask.in, name=заполняемый_параметр)
# note: Исключение элементов с нередактируемым параметром этажа
isReadOnly = Parameter.IsReadOnly(parameter=parameterByName)
filterByBoolMask_2 = List.FilterByBoolMask(list=filterByBoolMask.in, mask=isReadOnly)
boundingBox = Element.BoundingBox(element=filterByBoolMask_2.out)
isNull = Object.IsNull(obj=boundingBox)
filterByBoolMask_3 = List.FilterByBoolMask(list=filterByBoolMask_2.out, mask=isNull)
elements = CodeBlock(x=filterByBoolMask_3.out) { x; }
filterByBoolMask_4 = List.FilterByBoolMask(list=boundingBox, mask=isNull)
minPoint = BoundingBox.MinPoint(boundingBox=filterByBoolMask_4.out)
# note: Получение нижних координат
Z = Point.Z(point=minPoint)
basePoint = Coordinates.BasePoint()
Z_2 = Point.Z(point=basePoint)
convert_to_system_elevation = Python(IN[0]=Z, IN[1]=Z_2)  # "Convert To System Elevation PyScript"
# ---------- convert_to_system_elevation.python (4 lines) ----------
levelElevations = IN[0]
basePointOffset = IN[1]

OUT = [int(round(val - basePointOffset)) for val in levelElevations]
# ----------------------------------------
смещение_уровня_от_пола = IntegerSlider(100, range=0..300 step 50)  # graph input
code_block = CodeBlock(a=convert_to_system_elevation, delta=смещение_уровня_от_пола) { Math.Ceiling((a + 50) / 50) * 50 + delta; }
code_block_2 = CodeBlock { "Уровни"; }
byName_2 = Category.ByName(name=code_block_2)
all_elements_of_category_2 = ElementsOfCategory(Category=byName_2)
name_2 = Level.Name(level=all_elements_of_category_2)
code_block_3 = CodeBlock { " "; 0; }
split = String.Split(str=name_2, separater0=code_block_3.out0)
# note: Получение номеров и отметок этажей
getItemAtIndex = List.GetItemAtIndex(list=split@L2, index=code_block_3.out1)
is_contains_digit_pyscript = Python(IN[0]=getItemAtIndex)
# ---------- is_contains_digit_pyscript.python (5 lines) ----------
import re

inputStrings = IN[0]

OUT = [bool(re.search(r'\d', string)) for string in inputStrings]
# ----------------------------------------
filterByBoolMask_5 = List.FilterByBoolMask(list=getItemAtIndex, mask=is_contains_digit_pyscript)
toNumber = String.ToNumber(str=filterByBoolMask_5.in)
filterByBoolMask_6 = List.FilterByBoolMask(list=all_elements_of_category_2, mask=is_contains_digit_pyscript)
projectElevation = Level.ProjectElevation(level=filterByBoolMask_6.in)
basePoint_2 = Coordinates.BasePoint()
Z_3 = Point.Z(point=basePoint_2)
convert_to_system_elevation_2 = Python(IN[0]=projectElevation, IN[1]=Z_3)  # "Convert To System Elevation PyScript"; same code as convert_to_system_elevation
sortByKey = List.SortByKey(list=toNumber, keys=convert_to_system_elevation_2)
reverse = List.Reverse(list=sortByKey.sorted_list)
reverse_2 = List.Reverse(list=sortByKey.sorted_keys)
основной_код = Python(IN[0]=elements, IN[1]=code_block, IN[2]=reverse, IN[3]=reverse_2)
# ---------- основной_код.python (33 lines) ----------
import clr

clr.AddReference("RevitNodes")
import Revit

clr.ImportExtensions(Revit.Elements)

elements = IN[0]
elevations = IN[1]
lvlNumList = IN[2]
lvlElevList = IN[3]

output = []


offsetCategories = ["Перекрытия", "Каркас несущий"]

for value, element in zip(elevations, elements):
    categoryName = UnwrapElement(element).Category.Name
    value = value + 200 if categoryName in offsetCategories else value

    if value < 0:
        output.append(-1)
        continue

    for lvlElevation, lvlNumber in zip(lvlElevList, lvlNumList):

        if value > lvlElevation:
            output.append(lvlNumber)
            break


OUT = output
# ----------------------------------------
setParameterByName = Element.SetParameterByName(element=elements, parameterName=заполняемый_параметр, value=основной_код)
примечание = StringInput("""Данный скрипт заполняет параметр BI_этаж определяя где по высоте находится самая низкая точка объека
Номер этажа скрипт берет из названия уровня
Прнцип наименования уровня должна быть следующим:
12 Этаж, 100 Кровля ...""")  # graph input
watch = Watch(sortByKey.sorted_keys)
watch_2 = Watch(sortByKey.sorted_list)
